# Grasshopper definition sample_local.gh (Grasshopper 1.0.7)
# plug-ins: jSwan, Weaverbird

# N = axial load
# Vx = shear in x-axis
# Vy = shear in y-axis
# Mx = bending about the global X axis,
# My = bending about the global Y axis,
# Mz = torsional moment
# All dimensions are unitless and forces are in N.
# i.e. if you input the shape in centimetres then forces are N and moments are Ncm, result stresses are N/cm2 and resulting properties are all based around N and cm
stress_states_n_vx_vy_mx_my_mz = Panel("""1,1,0,0,0,0
1,0,1,0,0,0""")
cross_section_to_test_as_a_surface_on_xy = Surface(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)  # "Cross-Section To Test (as a Surface on XY Plane)"
c_script = CSharpScript(
    CrossSection=cross_section_to_test_as_a_surface_on_xy,
    meshSize="0.05",
    loadcases=stress_states_n_vx_vy_mx_my_mz,
    Reference="C:\Program Files\Rhino 6\System\Newtonsoft.Json.dll")  # -> out, mesh, json; inputs CrossSection: Brep, meshSize: Double, loadcases: list of String
# ---------- c_script: C# usings ----------
using System.Linq;
using Newtonsoft.Json;
# ---------- c_script: C# ----------
    Brep cs = CrossSection.DuplicateBrep();
    //get a random point in the brep
    Mesh[] quickMeshes = Mesh.CreateFromBrep(cs, MeshingParameters.Default);
    Point3d solidPoint = RandomPointInMesh(quickMeshes.ToList());

    //now find the closed edge loops and sort them to find the largest, outside one
    Rhino.Geometry.Collections.BrepEdgeList edgeList = cs.Edges;
    Curve[] edgeCurves = cs.DuplicateEdgeCurves(true);
    Curve[] joinedCurves = Curve.JoinCurves(edgeCurves, RhinoDocument.ModelAbsoluteTolerance);
    //select closed curves and calculate their area
    List<Curve> sectionCurves = new List<Curve>();
    List<double> curveArea = new List<double>();
    foreach(Curve crv in joinedCurves)
    {
      if(crv.IsClosed){
        sectionCurves.Add(crv);
        curveArea.Add(AreaMassProperties.Compute(crv).Area);
      }
    }

    //sort by area
    Curve[] sortedCurves = sectionCurves.ToArray();
    Array.Sort(curveArea.ToArray(), sortedCurves);
    Array.Reverse(sortedCurves);

    //check these are polylines. if they are not then convert to polyline
    List<PolylineCurve> edgePolylines = new List<PolylineCurve>();
    foreach(Curve crv in sortedCurves)
    {
      Polyline foundPLine;
      PolylineCurve foundLine = new PolylineCurve();
      bool found = crv.TryGetPolyline(out foundPLine);
      if (!found)
      {
        double minLength = meshSize / 10.0;
        double maxLength = meshSize;
        foundLine = crv.ToPolyline(meshSize, 2.0 * Math.PI, minLength, maxLength);
      }
      else
      {
        foundLine = foundPLine.ToPolylineCurve();
      }
      edgePolylines.Add(foundLine);
    }

    //foreach hole get a random point
    List<Point3d> holePoints = new List<Point3d>();
    for(int i = 1; i < edgePolylines.Count; i++)
    {
      Mesh polylineMesh = Mesh.CreateFromClosedPolyline(edgePolylines[i].ToPolyline());
      holePoints.Add(RandomPointInMesh(polylineMesh));
    }

    MeshingParameters param = new MeshingParameters();
    param.MaximumEdgeLength = Math.Sqrt(meshSize);

    //todo calculate edge length from meshSize as that's an area really!
    Mesh[] previewMeshes = Mesh.CreateFromBrep(cs, param);
    mesh = previewMeshes;

    CrossSectionInputData data = new CrossSectionInputData();
    data.perimeter = edgePolylines[0];
    data.control_points.Add(solidPoint);
    data.holes.AddRange(edgePolylines);
    data.holes.RemoveAt(0);
    data.hole_points.AddRange(holePoints);
    data.mesh_size = meshSize;

    //get load cases
    int lcCount = 0;
    foreach(string lc in loadcases){
      LoadCase loadCase = new LoadCase(lcCount, lc);
      data.loadcases.Add(loadCase);
      lcCount++;
    }

    json = JsonConvert.SerializeObject(data);
# ---------- c_script: C# additional code ----------
  public Point3d RandomPointInMesh(Mesh testMesh)
  {
    List<Point3d> faceCentroids = new List<Point3d>();
    int faceCount = testMesh.Faces.Count;
    for(int i = 0; i < faceCount; i++)
    {
      faceCentroids.Add(testMesh.Faces.GetFaceCenter(i));
    }
    Random rand = new Random(DateTime.Now.Millisecond);
    return faceCentroids[rand.Next(0, faceCentroids.Count - 1)];
  }
  public Point3d RandomPointInMesh(List<Mesh> testMeshes)
  {
    List<Point3d> faceCentroids = new List<Point3d>();
    foreach(Mesh mesh in testMeshes)
    {
      int faceCount = mesh.Faces.Count;
      for(int i = 0; i < faceCount; i++)
      {
        faceCentroids.Add(mesh.Faces.GetFaceCenter(i));
      }
    }
    Random rand = new Random(DateTime.Now.Millisecond);
    return faceCentroids[rand.Next(0, faceCentroids.Count - 1)];
  }

  public class CrossSectionInputData
  {
    public PolylineCurve perimeter;
    public List<Point3d> control_points;
    public List<PolylineCurve> holes;
    public List<Point3d> hole_points;
    public double mesh_size;
    public List<LoadCase> loadcases;

    public CrossSectionInputData()
    {
      control_points = new List<Point3d>();
      holes = new List<PolylineCurve>();
      hole_points = new List<Point3d>();
      loadcases = new List<LoadCase>();
    }
  }

  public class LoadCase{
    public int LC = 0;
    public double N = 0;
    public double Vx = 0;
    public double Vy = 0;
    public double Mxx = 0;
    public double Myy = 0;
    public double Mzz = 0;

    public LoadCase(int lc, double n, double vx, double vy, double mxx, double myy, double mzz){
      setup(lc, n, vx, vy, mxx, myy, mzz);
    }

    public LoadCase(int lc, string values){
      Char[] splitters = new Char[1]{','};
      string[] splitParts = values.Split(splitters);
      setup(lc, Convert.ToDouble(splitParts[0]), Convert.ToDouble(splitParts[1]), Convert.ToDouble(splitParts[2]), Convert.ToDouble(splitParts[3]), Convert.ToDouble(splitParts[4]), Convert.ToDouble(splitParts[5]));
    }

    public void setup(int lc, double n, double vx, double vy, double mxx, double myy, double mzz){
      LC = lc;
      N = n;
      Vx = vx;
      Vy = vy;
      Mxx = mxx;
      Myy = myy;
      Mzz = mzz;
    }
  }
# ---------- end c_script ----------
# This shows you APPROXIMATELY the mesh density you will be generating in the python module. Check to make sure it's not insanely dense before running the next component!
approximatemesh_forchecking = Mesh(c_script.mesh)
runtime_limit_to_prevent_major_blunders = Panel("40")
# right click and make sure this path is set to where you have stashed the app_local.py file you downloaded
path_to_app_local_py = FilePath("D:\Libraries\GITHUB\section-properties-web\app_local.py")
c_script_2 = CSharpScript(section_json=c_script.json, python_app_path=path_to_app_local_py, seconds=runtime_limit_to_prevent_major_blunders)  # -> out, A, B; inputs section_json: String, python_app_path: String, seconds: Int32; disabled
# ---------- c_script_2: C# usings ----------
using System.Linq;
using System.IO;
using System.Diagnostics;
using System.Text;
using System.Threading.Tasks;
# ---------- c_script_2: C# ----------
    if(results == null)
    {
      start = DateTime.UtcNow;
      this.Component.Message = "Running...";
      //convert the python path to one it can actually read
      Task.Run(() => ExecuteProgram(section_json, python_app_path, seconds)).ContinueWith(t =>
        {
        this.Component.Message = string.Format("Done! ({0:0}ms)", (DateTime.UtcNow - start).TotalMilliseconds);
        results = t.Result;
        Component.ExpireSolution(true);
        });
    }

    if(results != null){
      A = results[0];
      B = results[1];
    }else{
      A = "wait";
      B = "wait";
    }

    results = null;
# ---------- c_script_2: C# additional code ----------
  List<String> results;
  DateTime start;

  int DoStuff(string data)
  {
    System.Threading.Thread.Sleep(1000);

    return data.Length;
  }

  public List<string> ExecuteProgram(string section_json, string python_app_path, int timeLimit){
    string filepath = GrasshopperDocument.FilePath;
    filepath = filepath.Substring(0, filepath.Length - 3);
    filepath = filepath + "-sectionjson.txt";
    int waittime = 1000 * timeLimit; //10 seconds max

    System.IO.File.WriteAllText(filepath, section_json);

    var sb = new StringBuilder();
    var sbe = new StringBuilder();

    Process p = new Process();

    p.StartInfo.RedirectStandardOutput = true;
    p.StartInfo.RedirectStandardError = true;

    p.OutputDataReceived += (sender, args) => sb.AppendLine(args.Data);
    p.ErrorDataReceived += (sender, args) => sbe.AppendLine(args.Data);

    const string quote = "\"";

    string pythonPath = Path.GetDirectoryName(python_app_path);
    pythonPath = Path.Combine(pythonPath, "WPy64\\scripts\\winpython.bat");
    //if you want to run the file using your normal python distn:
    //pythonPath = "Python";

    p.StartInfo.UseShellExecute = false;
    p.StartInfo.CreateNoWindow = true;
    p.StartInfo.FileName = quote + pythonPath + quote;
    string cmd = quote + python_app_path + quote;
    string arg = quote + filepath + quote;

    p.StartInfo.Arguments = string.Format("{0} {1}", cmd, arg);
    p.Start();

    p.BeginOutputReadLine();
    p.BeginErrorReadLine();

    bool check = p.WaitForExit(waittime);
    if(check == false){
      p.Kill();
      sbe.AppendLine("process killed for taking too long");
    }

    return new List<string>(){sb.ToString(),sbe.ToString()};
  }
# ---------- end c_script_2 ----------
dejson = DeserializeJson(JSON=c_script_2.A, OutputsLocked=False)  # -> Properties, Geometry, Images, Stress_results
data = Data(dejson.Properties)
# retrieved units depend on input dimensions i.e. mm2 vs cm2 vs m2
dejson_2 = DeserializeJson(JSON=data, OutputsLocked=False)  # -> Area, Avx, Avy, Xg, Yg, Rxx, Ryy, Phi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
dejson_3 = DeserializeJson(JSON=dejson.Images, OutputsLocked=False)  # -> Centroids, Unittorsion_vxy_stress, Lc_0_vm_stress, Lc_1_vm_stress
dejson_4 = DeserializeJson(JSON=dejson.Geometry, OutputsLocked=False)
dejson_5 = DeserializeJson(JSON=dejson.Stress_results, OutputsLocked=False)  # -> Unittorsion_vxy_stress, Lc_0_vm_stress, Lc_1_vm_stress
dejson_6 = DeserializeJson(JSON=dejson_5.Unittorsion_vxy_stress, OutputsLocked=False)
bnd = Bounds(Numbers=dejson_6)
c_script_3 = CSharpScript(jsonMesh=dejson_4, Reference="C:\Program Files\Rhino 6\System\Newtonsoft.Json.dll")  # -> rhinoMesh; inputs jsonMesh: String
# ---------- c_script_3: C# ----------
    var mesh = JsonConvert.DeserializeObject<Mesh>(jsonMesh);
    rhinoMesh = mesh;
# ---------- end c_script_3 ----------
dedomain = DeconstructDomain(Domain=bnd)  # -> Start, End
gradient = Gradient(
    LowerLimit=dedomain.Start,
    UpperLimit=dedomain.End,
    Parameter=dejson_6,
    stops=[0: RGB(0, 77, 128), 0.589: RGB(0, 255, 0), 0.781: RGB(255, 255, 0), 1: RGB(255, 0, 0)])
wbvertices = WeaverbirdsVerticesComponent(MeshClosedPolylinesGroup=c_script_3, Weld=True)
creates_popup_image = CSharpScript(base64png=dejson_3.Lc_0_vm_stress, filename="image.png", loadImage=Button())  # -> out, A; inputs base64png: String, filename: String, loadImage: Boolean
# ---------- creates_popup_image: C# usings ----------
using System.IO;
using System.Drawing;
using System.Windows.Forms;
using System.ComponentModel;
using System.Runtime.CompilerServices;
# ---------- creates_popup_image: C# ----------
    string newFileName = null;
    if(filename != null){
      string dirName = Path.GetDirectoryName(GrasshopperDocument.FilePath);
      newFileName = Path.Combine(dirName, filename);
    }else{
      string dirName = Path.GetDirectoryName(GrasshopperDocument.FilePath);
      newFileName = Path.Combine(dirName, "-image.png");
    }

    popUpImage = null;

    byte[] imgBytes = Convert.FromBase64String(base64png);

    if(loadImage){
      using (var imageFile = new FileStream(newFileName, FileMode.Create))
      {
        imageFile.Write(imgBytes, 0, imgBytes.Length);
        imageFile.Flush();
      }

      if(popUpImage != null){
        popUpImage.Dispose();
      }
      popUpImage = new FormItemImage(this.Component, newFileName);
    }

    //FormItemImage image2 = new FormItemImage(this.Component, newFileName);
# ---------- creates_popup_image: C# additional code ----------
  FormItemImage popUpImage = null;

  public class FormItemImage : Form
  {
    private IContainer components = null;

    public FormItemImage(IGH_Component component, string filename)
    {
      this.InitializeComponent();


      //location of object on the canvas:
      System.Drawing.PointF mappedPoint = Grasshopper.Instances.ActiveCanvas.Viewport.ProjectPoint(component.Attributes.Bounds.Location);

      //find component bounds and make one image property as 3*width
      int componentWidth = (int) component.Attributes.Bounds.Width;
      int componentHeight = (int) component.Attributes.Bounds.Height;

      mappedPoint.Y = mappedPoint.Y + componentHeight * 2;

      //now find location in screen space:
      System.Drawing.Point controlPoint = new System.Drawing.Point((int) mappedPoint.X, (int) mappedPoint.Y);

      //place the preview below the component by it's own height
      System.Drawing.Point location = Grasshopper.Instances.ActiveCanvas.PointToScreen(controlPoint);

      //update by the control box dims
      location.X = location.X;
      Image image;
      using (FileStream stream = new FileStream(filename, FileMode.Open, FileAccess.Read))
      {
        image = Image.FromStream(stream);
      }
      double num = (double) image.Height / (double) image.Width;
      int width = Math.Min(componentWidth * 3, image.Width);
      int height = checked((int) Math.Round(unchecked((double) width * num)));
      this.Location = location;
      this.Size = new Size(width, height);
      this.PictureBox_Item.Image = image;
      this.Show();
    }

    protected override void Dispose(bool disposing)
    {
      try
      {
        if (!disposing || this.components == null)
          return;
        this.components.Dispose();
      }
      finally
      {
        base.Dispose(disposing);
      }
    }

    private void InitializeComponent()
    {

      this.PictureBox_Item = new PictureBox();
      ((ISupportInitialize) this.PictureBox_Item).BeginInit();
      this.SuspendLayout();
      this.PictureBox_Item.Dock = DockStyle.Fill;
      this.PictureBox_Item.Location = new System.Drawing.Point(0, 0);
      this.PictureBox_Item.Name = "PictureBox_Item";
      this.PictureBox_Item.Size = new Size(284, 261);
      this.PictureBox_Item.TabIndex = 0;
      this.PictureBox_Item.TabStop = false;
      this.PictureBox_Item.SizeMode = PictureBoxSizeMode.StretchImage;
      this.AutoScaleDimensions = new SizeF(6f, 13f);
      this.AutoScaleMode = AutoScaleMode.Font;
      this.ClientSize = new Size(284, 261);
      this.ControlBox = true;
      this.Controls.Add((Control) this.PictureBox_Item);
      this.FormBorderStyle = FormBorderStyle.Sizable;
      this.StartPosition = FormStartPosition.Manual;
      this.Name = "Form_ItemImage";
      ((ISupportInitialize) this.PictureBox_Item).EndInit();
      this.ResumeLayout(false);
    }

    internal virtual PictureBox PictureBox_Item {get;[MethodImpl(MethodImplOptions.Synchronized)] set;}
  }
# ---------- end creates_popup_image ----------
mspray = MeshSpray(Mesh=c_script_3, Points=wbvertices, Colours=gradient, SprayMode=10)
